# Grasshopper definition VariableOffset.gh (Grasshopper 1.0.8)
# plug-ins: VariableOffset

genes = GenePool(Decimals=1, Maximum=500, Minimum=0, Value=[77, 72.7, 100.3, 47.1, 62, 47.1, 158.8, 35.3])
genes_2 = GenePool(Decimals=1, Maximum=500, Minimum=0, Value=[77, 72.7, 68.6, 47.1, 39.7, 47.1, 34.2, 86.6])
crv = Curve([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])
graft = GraftTree(Tree=crv, IncludeEmptyLists=True, IncludeNullItems=True)
entwine = Entwine(Branch00=genes, Branch01=genes_2, FlattenInputs=True)
neg = Negative(Value=entwine)
edgeoffset = VariableEdgeOffset(Curves=graft, EdgeOffsets=neg)
